# Grasshopper definition islamic.gh (Grasshopper 0.9.76)

# ---- group: decagon
cir = Circle(Plane=PlaneXY(0, 0, 0), Radius=Slider(10, range=0..30))

# ---- group: pentagon
cir_2 = Circle(Plane=PlaneXY(0, 0, 0), Radius=Slider(4, range=0..20))

# ----
divide = DivideCurve(Curve=cir, Count=10, Kinks=False)  # -> Points, Tangents, Parameters
divide_2 = DivideCurve(Curve=cir_2, Count=5, Kinks=False)  # -> Points, Tangents, Parameters
points = PointList(Points=divide.Points, Size=Slider(2, range=0..8))
points_2 = PointList(Points=divide_2.Points, Size=Slider(2, range=0..8))
item = ListItem(List=divide.Points, Index=0, Wrap=True)  # -> Item, Item1, Item2, Item3, Item4, Item5, Item6, Item7, Item8, Item9
item_2 = ListItem(List=divide_2.Points, Index=0, Wrap=True)  # -> Item, Item1, Item2, Item3, Item4
offset = Slider(3, range=-10..8)
offset_2 = Slider(-2, range=-10..8)
srf4pt = _4PointSurface(CornerA=item.Item1, CornerB=item.Item2, CornerC=item.Item6, CornerD=item.Item7)
srf4pt_2 = _4PointSurface(CornerA=item.Item1, CornerB=item.Item5, CornerC=item.Item6, CornerD=item.Item)
srf4pt_3 = _4PointSurface(CornerA=item.Item2, CornerB=item.Item3, CornerC=item.Item7, CornerD=item.Item8)
srf4pt_4 = _4PointSurface(CornerA=item.Item, CornerB=item.Item4, CornerC=item.Item5, CornerD=item.Item9)
srf4pt_5 = _4PointSurface(CornerA=item.Item9, CornerB=item.Item3, CornerC=item.Item4, CornerD=item.Item8)
srf4pt_6 = _4PointSurface(CornerA=item.Item, CornerB=item.Item2, CornerC=item_2.Item1, CornerD=item_2.Item)
srf4pt_7 = _4PointSurface(CornerA=item.Item6, CornerB=item.Item8, CornerC=item_2.Item4, CornerD=item_2.Item3)
srf4pt_8 = _4PointSurface(CornerA=item_2.Item1, CornerB=item.Item2, CornerC=item.Item4, CornerD=item_2.Item2)
srf4pt_9 = _4PointSurface(CornerA=item.Item8, CornerB=item.Item, CornerC=item_2.Item, CornerD=item_2.Item4)
srf4pt_10 = _4PointSurface(CornerA=item.Item6, CornerB=item_2.Item3, CornerC=item_2.Item2, CornerD=item.Item4)
offset_3 = Offset(Curve=[srf4pt_5, srf4pt, srf4pt_2, srf4pt_3, srf4pt_4], Distance=offset_2, Plane=PlaneXY(0, 0, 0), Corners=1)
offset_4 = Offset(Curve=[srf4pt_7, srf4pt_6, srf4pt_9, srf4pt_10, srf4pt_8], Distance=offset, Plane=PlaneXY(0, 0, 0), Corners=1)
brep = Brep(offset_3)
brep_2 = Brep(offset_4)
